# Dynamo graph as_familybygeometry.dyn "FamilyByGeometry" (Dynamo 2.3.0.5885)
# packages: Clockwork for Dynamo 2.x 2.1.2, spring nodes 202.1.1, Prorubim DS Common Kit 0.4.3, BlackBox 2016.8.5

select_model_element = DSModelElementSelection()  # 1 picked in the model
nestedFamily = Custom[Get.NestedFamily](Elements=select_model_element)  # package BlackBox; This node uses the SuperComponent and SubComponets properties of Revit API to organize the elements into lists based on there make-up. I haven't tested multiple nested families but have found it helpfull esp. on Doors, Plumbing Fixtures, & Casework to find out which family is nested in which parent
forceChildrensEval = ForceChildrensEval()  # unwired: passObject, passObject_2
ꟿ_document_activeview = Custom[ꟿ Document.ActiveView](refresh=forceChildrensEval.out1)  # package spring nodes; Selects the current document's active view. Supports more view types than the built-in option. Will be depreciated once the bult in node works with all plan types.
code_block = CodeBlock { true; }
geometry = Custom[Element.Geometry+](element=nestedFamily.Nested_Family, view=ꟿ_document_activeview, returnGeometryWithoutInserts=code_block)  # package Clockwork for Dynamo 2.x; Returns Dynamo AND native Revit geometry of a given element
flatten = List.Flatten(list=geometry.revitGeometry)
byUnion = Solid.ByUnion(solids=flatten)
code_block_2 = CodeBlock { "Семейство"; }
code_block_3 = CodeBlock { "Обобщенные модели"; }
byName = Category.ByName(name=code_block_3)
file_path = Filename("C:\ProgramData\Autodesk\RVT 2019\Family Templates\Russian\Метрическая система, типовая модель.rft")
code_block_4 = CodeBlock { "По умолчанию"; }
byName_2 = Material.ByName(name=code_block_4)
byGeometry = FamilyType.ByGeometry(solidGeometry=byUnion, name=code_block_2, category=byName, templatePath=file_path, material=byName_2)
